# Grasshopper definition 0628_print test 01_nonplanar.gh (Grasshopper 1.0.8)
# plug-ins: treesloth01, Pufferfish, Mesh Pipe

# ---- group: Printing bed
pt = Point(Point(1.46383428e-07, -395.2788595, -24.31783007))
pdecon = Deconstruct(Point=pt)  # -> XComponent, YComponent, ZComponent
division = Division(A="1500", B="2")
division_2 = Division(A="1000", B="2")
division_3 = Division(A="50", B="2")
neg = Negative(Value=division_3)
pt_2 = ConstructPoint(XCoordinate=pdecon.XComponent, YCoordinate=pdecon.YComponent, ZCoordinate=neg)
box = CenterBox(Base=pt_2, X=division, Y=division_2, Z=division_3)

# ---- group: Cantilever
py3 = Python3Script(
    layer_z="0.0",
    line_spacing=Slider(20, range=0..100),
    bed_line_count=Slider(4, range=0..10),
    bed_line_length=Slider(300, range=0..1000),
    vertical_line_count=Slider(6, range=0..100),
    vertical_height=Slider(200, range=0..1000),
    vertical_height_step=Slider(50, range=0..100),
    cantilever_line_count=Slider(10, range=0..10),
    cantilever_length=Slider(100, range=0..1000),
    cantilever_length_step=Slider(50, range=0..100))  # -> out, points, polyline, segments; inputs layer_z: Double, line_spacing: Double, bed_line_count: Int32, bed_line_length: Double, vertical_line_count: Int32, vertical_height: Double, vertical_height_step: Double, cantilever_line_count: Int32, cantilever_length: Double, cantilever_length_step: Double
# ---------- py3: Python ----------
import Rhino.Geometry as rg

# ------------------------------------------------------------
# Helper functions
# ------------------------------------------------------------

def add_ordered_points(toolpath_pts, pts, reverse=False, tolerance=0.001):
    """
    Add points to toolpath.
    If reverse is True, the point order is reversed.
    The first point is only added if it is not already the current last point.
    """

    if reverse:
        pts = pts[::-1]

    if len(toolpath_pts) == 0:
        toolpath_pts.extend(pts)
    else:
        if toolpath_pts[-1].DistanceTo(pts[0]) > tolerance:
            toolpath_pts.append(pts[0])

        toolpath_pts.extend(pts[1:])


# ------------------------------------------------------------
# 1. Generate bed lines
# ------------------------------------------------------------

toolpath_pts = []

for i in range(bed_line_count):

    x = -i * line_spacing

    p0 = rg.Point3d(x, 0, layer_z)
    p1 = rg.Point3d(x, -bed_line_length, layer_z)

    add_ordered_points(
        toolpath_pts,
        [p0, p1],
        reverse=(i % 2 != 0),
    )


# ------------------------------------------------------------
# 2. Generate vertical / perpendicular lines after bed lines
# ------------------------------------------------------------

start_pt = toolpath_pts[-1]

start_x = start_pt.X
start_y = start_pt.Y
start_z = start_pt.Z

for j in range(vertical_line_count):

    x = start_x - j * line_spacing
    height_offset = (j // 2) * vertical_height_step

    base_pt = rg.Point3d(x, start_y, start_z)
    top_pt = rg.Point3d(x, start_y, start_z + vertical_height + height_offset)

    add_ordered_points(
        toolpath_pts,
        [base_pt, top_pt],
        reverse=(j % 2 != 0),
    )


# ------------------------------------------------------------
# 3. Generate vertical + cantilever lines
# ------------------------------------------------------------

previous_pt = toolpath_pts[-1]

start_pt = rg.Point3d(
    previous_pt.X - line_spacing,
    previous_pt.Y,
    previous_pt.Z
)

add_ordered_points(
    toolpath_pts,
    [start_pt],
    reverse=False,
)

start_x = start_pt.X
start_y = start_pt.Y
start_z = start_pt.Z

for k in range(cantilever_line_count):

    x = start_x - k * line_spacing
    current_cantilever_length = cantilever_length + (k // 2) * cantilever_length_step

    base_pt = rg.Point3d(x, start_y, start_z)
    top_pt = rg.Point3d(x, start_y, start_z + vertical_height)
    cantilever_pt = rg.Point3d(
        top_pt.X,
        top_pt.Y - current_cantilever_length,
        top_pt.Z
    )

    add_ordered_points(
        toolpath_pts,
        [base_pt, top_pt, cantilever_pt],
        reverse=(k % 2 != 0),
    )


# ------------------------------------------------------------
# 4. Create final polyline and curve segments
# ------------------------------------------------------------

points = toolpath_pts
polyline = rg.Polyline(toolpath_pts)

segments = []
for i in range(len(toolpath_pts) - 1):
    segments.append(rg.LineCurve(toolpath_pts[i], toolpath_pts[i + 1]))
# ---------- end py3 ----------
geo = Geometry(py3.polyline)

# ---- group: Overhang angle
py3_2 = Python3Script(
    layer_z="0.0",
    line_spacing=Slider(20, range=0..100),
    bed_line_count=Slider(4, range=0..10),
    bed_line_length=Slider(300, range=0..1000),
    vertical_line_count=Slider(6, range=0..10),
    vertical_height=Slider(200, range=0..1000),
    vertical_height_step=Slider(50, range=0..100),
    overhang_line_count=Slider(39, range=0..100),
    overhang_length=Slider(100, range=0..1000),
    overhang_length_step=Slider(50, range=0..100),
    angle_step=Slider(15, range=0..100))  # -> out, points, polyline, segments; inputs layer_z: Double, line_spacing: Double, bed_line_count: Int32, bed_line_length: Double, vertical_line_count: Int32, vertical_height: Double, vertical_height_step: Double, overhang_line_count: Int32, overhang_length: Double, overhang_length_step: Double, angle_step: Int32
# ---------- py3_2: Python ----------
import Rhino.Geometry as rg
import math


# ------------------------------------------------------------
# Helper functions
# ------------------------------------------------------------

def add_ordered_points(toolpath_pts, pts, reverse=False, tolerance=0.001):
    """
    Add a list of points to the toolpath.

    If reverse is True, the point order is reversed.
    The first point is only added when it is not already
    """

    if reverse:
        pts = pts[::-1]

    if len(toolpath_pts) == 0:
        toolpath_pts.extend(pts)
        return

    if toolpath_pts[-1].DistanceTo(pts[0]) > tolerance:
        toolpath_pts.append(pts[0])

    toolpath_pts.extend(pts[1:])


def point_from_angle_distance(start_pt, angle_deg, distance):
    angle_rad = math.radians(angle_deg)

    vec = rg.Vector3d.ZAxis
    vec.Rotate(angle_rad, rg.Vector3d.XAxis)
    vec.Unitize()

    return start_pt + vec * distance


# ------------------------------------------------------------
# 1. Generate bed lines
# ------------------------------------------------------------

toolpath_pts = []

for i in range(int(bed_line_count)):

    x = -i * line_spacing

    bed_start_pt = rg.Point3d(x, 0, layer_z)
    bed_end_pt = rg.Point3d(x, -bed_line_length, layer_z)

    add_ordered_points(
        toolpath_pts,
        [bed_start_pt, bed_end_pt],
        reverse=(i % 2 != 0)
    )


# ------------------------------------------------------------
# 2. Generate vertical + angled overhang test lines
# ------------------------------------------------------------

previous_pt = toolpath_pts[-1]

start_pt = rg.Point3d(
    previous_pt.X - line_spacing,
    previous_pt.Y,
    previous_pt.Z
)

add_ordered_points(toolpath_pts, [start_pt])

start_x = start_pt.X
start_y = start_pt.Y
start_z = start_pt.Z


overhang_angles = list(range(15, 180, angle_step))
# overhang_angles = [
#     angle_start + i * angle_step
#     for i in range(angle_count)
# ]

angles_per_length = len(overhang_angles)


# Offset direction for the return path
return_offset_vec = rg.Vector3d(line_spacing, 0, 0)


for test_id in range(overhang_line_count):

    # --------------------------------------------------------
    # Determine angle and length group
    # --------------------------------------------------------

    angle_index = test_id % angles_per_length
    length_group_id = test_id // angles_per_length

    angle_deg = overhang_angles[angle_index]

    test_length = overhang_length + length_group_id * overhang_length_step


    # --------------------------------------------------------
    # Generate base, top, and angled overhang points
    # --------------------------------------------------------

    x = start_x - test_id * line_spacing * 2

    base_pt = rg.Point3d(
        x,
        start_y,
        start_z
    )

    top_pt = rg.Point3d(
        x,
        start_y,
        start_z + vertical_height
    )

    overhang_end_pt = point_from_angle_distance(top_pt, angle_deg, test_length)


    # --------------------------------------------------------
    # Generate offset return points
    # --------------------------------------------------------

    offset_base_pt = base_pt - return_offset_vec
    offset_top_pt = top_pt - return_offset_vec
    offset_overhang_end_pt = overhang_end_pt - return_offset_vec


    # --------------------------------------------------------
    # base → top → overhang end
    #      → offset overhang end → offset top → offset base
    # --------------------------------------------------------

    test_pts = [
        base_pt,
        top_pt,
        overhang_end_pt,
        offset_overhang_end_pt,
        offset_top_pt,
        offset_base_pt
    ]

    add_ordered_points(
        toolpath_pts,
        test_pts,
        reverse=(test_id % 2 != 0)
    )


# ------------------------------------------------------------
# 3. Create final polyline and curve segments
# ------------------------------------------------------------

points = toolpath_pts
polyline = rg.Polyline(toolpath_pts)

segments = []
for i in range(len(toolpath_pts) - 1):
    segments.append(rg.LineCurve(toolpath_pts[i], toolpath_pts[i + 1])) # curve version of the lines
# ---------- end py3_2 ----------
geo_2 = Geometry(py3_2.points)
geo_3 = Geometry(py3_2.polyline)

# ---- group: Non-planar_a
number_slider = Slider(12, range=0..100)  # disabled
panel = Panel("0 to 1")  # disabled
number_slider_2 = Slider(30, range=0..500)  # disabled
number_slider_3 = Slider(120, range=0..1000)  # disabled
range = Range(Domain=panel, Steps=expr("x-1", number_slider))  # disabled
graph = GraphMapper(range, x0=0, x1=1, y0=0, y1=1, container_name="Sine", Equation_px=[0, 0.2509106696], Equation_py=[0, 1])  # disabled
dom = ConstructDomain(DomainStart=number_slider_2, DomainEnd=number_slider_3)  # disabled
remap = RemapNumbers(Value=graph, Source=panel, Target=dom)  # -> Mapped, Clipped; disabled
dispatch = Dispatch(List=remap.Mapped, DispatchPattern=[True, False])  # -> ListA, ListB; disabled

# ---- group: Non-planar_b
number_slider_4 = Slider(12, range=0..100)
range_2 = Range(Domain="0 to 1", Steps=expr("x-1", number_slider_4))
dom_2 = ConstructDomain(DomainStart=Slider(30, range=0..500), DomainEnd=Slider(120, range=0..1000))
remap_2 = RemapNumbers(Value=range_2, Source="0 to 1", Target=dom_2)  # -> Mapped, Clipped
dispatch_2 = Dispatch(List=remap_2.Mapped, DispatchPattern=[True, False])  # -> ListA, ListB

number_slider_5 = Slider(12, range=0..100)  # disabled
number_slider_6 = Slider(30, range=0..500)  # disabled
number_slider_7 = Slider(120, range=0..1000)  # disabled
panel_2 = Panel("0 to 1")  # disabled
range_3 = Range(Domain=panel_2, Steps=expr("x-1", number_slider_5))  # disabled
dom_3 = ConstructDomain(DomainStart=number_slider_6, DomainEnd=number_slider_7)  # disabled
remap_3 = RemapNumbers(Value=range_3, Source=panel_2, Target=dom_3)  # -> Mapped, Clipped; disabled
dispatch_3 = Dispatch(List=remap_3.Mapped, DispatchPattern=[True, False])  # -> ListA, ListB; disabled

panel_3 = Panel("{0,0,0}")

cir = Circle(Plane=panel_3, Radius=Slider(200, range=0..1000))
ptdivcrvsegs = PointDivideCurveSegments(Curve=cir, Number=number_slider_4, EndPoint=False)  # -> Points, Tangents, Parameters
dispatch_4 = Dispatch(List=ptdivcrvsegs.Points, DispatchPattern=[True, False])  # -> ListA, ListB
Z = UnitZ(Factor=dispatch_2.ListA)
move = Move(Geometry=dispatch_4.ListA, Motion=Z)  # -> Geometry, Transform
weave = Weave(Pattern=[0, 1], Stream0=move.Geometry, Stream1=dispatch_4.ListB, NullGaps=False)
intcrv = Interpolate(Vertices=weave, Degree=3, Periodic=invert(False), KnotStyle=1)  # -> Curve, Length, Domain

panel_4 = Panel("{0,0,0}")  # disabled

number_slider_8 = Slider(200, range=0..1000)  # disabled
cir_2 = Circle(Plane=panel_4, Radius=number_slider_8)  # disabled
ptdivcrvsegs_2 = PointDivideCurveSegments(Curve=cir_2, Number=number_slider_5, EndPoint=False)  # -> Points, Tangents, Parameters; disabled
dispatch_5 = Dispatch(List=ptdivcrvsegs_2.Points, DispatchPattern=[True, False])  # -> ListA, ListB; disabled
Z_2 = UnitZ(Factor=dispatch_3.ListA)  # disabled
move_2 = Move(Geometry=dispatch_5.ListA, Motion=Z_2)  # -> Geometry, Transform; disabled
weave_2 = Weave(Pattern=[0, 1], Stream0=move_2.Geometry, Stream1=dispatch_5.ListB, NullGaps=False)  # disabled
intcrv_2 = Interpolate(Vertices=weave_2, Degree=3, Periodic=invert(False), KnotStyle=1)  # -> Curve, Length, Domain; disabled

# ----
X = UnitX(Factor=1)
line = LineSDL(Start="{0,0,0}", Direction=X, Length=Slider(300, range=0..1000))
rotate = Rotate(Geometry=line, Angle=degrees(Slider(60, range=0..180)), Plane=PlaneXY(0, 0, 0))  # -> Geometry, Transform

# ---- group: Non-planar_b / bead height
number_slider_9 = Slider(10, range=0..100)

# ---- group: Non-planar_b
number_slider_10 = Slider(300, range=0..1000)
division_4 = Division(A=number_slider_10, B=number_slider_9)
Z_3 = UnitZ(Factor=number_slider_10)
round = Round(Number=division_4)  # -> Nearest, Floor, Ceiling
move_3 = Move(Geometry=intcrv.Curve, Motion=Z_3)  # -> Geometry, Transform
range_4 = Range(Domain=Domain(0, 1), Steps=expr("x-1", round.Ceiling))
rulesrf = RuledSurface(CurveA=cir, CurveB=move_3.Geometry)
tweencrv = TweenCurve(CurveA=cir, CurveB=move_3.Geometry, Factor=range_4, BlendType=0)

# ---- group: Non-planar_b / bead height
number_slider_11 = Slider(10, range=0..100)  # disabled

# ---- group: Non-planar_b
number_slider_12 = Slider(300, range=0..1000)  # disabled
division_5 = Division(A=number_slider_12, B=number_slider_11)  # disabled
Z_4 = UnitZ(Factor=number_slider_12)  # disabled
round_2 = Round(Number=division_5)  # -> Nearest, Floor, Ceiling; disabled
move_4 = Move(Geometry=intcrv_2.Curve, Motion=Z_4)  # -> Geometry, Transform; disabled
range_5 = Range(Domain=Domain(0, 1), Steps=expr("x-1", round_2.Ceiling))  # disabled
rulesrf_2 = RuledSurface(CurveA=cir_2, CurveB=move_4.Geometry)  # disabled
tweencrv_2 = TweenCurve(CurveA=cir_2, CurveB=move_4.Geometry, Factor=range_5, BlendType=0)  # disabled

# ----
join = JoinCurves(Curves=[line, rotate.Geometry], Preserve=False)
Z_5 = UnitZ(Factor=Slider(200, range=0..1000))
extr = Extrude(Base=join, Direction=Z_5)

# ---- group: Non-planar_a
number_slider_13 = Slider(1, range=0..10)  # disabled
panel_5 = Panel("360")  # disabled
division_6 = Division(A=panel_5, B=number_slider)  # disabled
multiplication = Multiplication(A=division_6, B=number_slider_13)  # disabled

number_slider_14 = Slider(1, range=0..10)  # disabled
panel_6 = Panel("360")  # disabled
division_7 = Division(A=panel_6, B=number_slider)  # disabled
multiplication_2 = Multiplication(A=division_7, B=number_slider_14)  # disabled

# ---- group: Non-planar_b / interval checking
ptdivcrvsegs_3 = PointDivideCurveSegments(Curve=tweencrv, Number=number_slider_4, EndPoint=False)  # -> Points, Tangents, Parameters
flip = FlipMatrix(Data=ptdivcrvsegs_3.Points)
pline = PolyLine(Vertices=flip, Closed=False)  # -> flatten(Polyline)
explode = Explode(Curve=pline, Recursive=True)  # -> Segments, Vertices
len = Length(Curve=explode.Segments)
sort = SortList(Keys=flatten(len), ValuesA=flatten(explode.Segments))  # -> Keys, ValuesA
first_last = FirstLast(List=sort.Keys)  # -> FirstValue, LastValue
panel_7 = Panel(first_last.FirstValue)
panel_8 = Panel(first_last.LastValue)
mindex = MemberIndex(Set=sort.Keys, Member=first_last.FirstValue)  # -> Index, Count
mindex_2 = MemberIndex(Set=sort.Keys, Member=first_last.LastValue)  # -> Index, Count
item = ListItem(List=sort.ValuesA, Index=[mindex.Index, mindex_2.Index], Wrap=True)
crv = Curve(item)

# ---- group: Non-planar_b / continuous toolpath
neg_2 = Negative(Value=Slider(20, range=0..100))
ext = ExtendCurve(Curve=tweencrv, Type=0, Start=Slider(0, range=0..10), End=neg_2)
end = EndPoints(Curve=ext)  # -> Start, End
shift = ShiftList(List=end.Start, Shift=1, Wrap=invert(True))
cull_i = CullIndex(List=end.End, Indices="-1", Wrap=True)
ln = Line(StartPoint=cull_i, EndPoint=shift)
tail_length = Slider(300, range=0..1000)
join_2 = JoinCurves(Curves=flatten([ext, ln]), Preserve=False)
X_2 = UnitX(Factor=1)
end_2 = EndPoints(Curve=join_2)  # -> Start, End
line_2 = LineSDL(Start=end_2.Start, Direction=X_2, Length=tail_length)
join_3 = JoinCurves(Curves=[line_2, join_2], Preserve=False)
flip_2 = FlipCurve(Curve=join_3)  # -> Curve, Flag
curvepoint = PointOnCurve(flip_2.Curve, parameter=0.124)
crv_2 = Curve(flip_2.Curve)
mpipe = MeshPipe(Curve=crv_2, Radius=Slider(5, range=0..10), Accuracy=0.2, Rotation=0, Segments=10, Caps=2)

# ---- group: Non-planar_b / interval checking
ptdivcrvsegs_4 = PointDivideCurveSegments(Curve=tweencrv_2, Number=number_slider_5, EndPoint=False)  # -> Points, Tangents, Parameters; disabled
flip_3 = FlipMatrix(Data=ptdivcrvsegs_4.Points)  # disabled
pline_2 = PolyLine(Vertices=flip_3, Closed=False)  # -> flatten(Polyline); disabled
explode_2 = Explode(Curve=pline_2, Recursive=True)  # -> Segments, Vertices; disabled
len_2 = Length(Curve=explode_2.Segments)  # disabled
sort_2 = SortList(Keys=flatten(len_2), ValuesA=flatten(explode_2.Segments))  # -> Keys, ValuesA; disabled
first_last_2 = FirstLast(List=sort_2.Keys)  # -> FirstValue, LastValue; disabled
panel_9 = Panel(first_last_2.FirstValue)  # disabled
panel_10 = Panel(first_last_2.LastValue)  # disabled
mindex_3 = MemberIndex(Set=sort_2.Keys, Member=first_last_2.FirstValue)  # -> Index, Count; disabled
mindex_4 = MemberIndex(Set=sort_2.Keys, Member=first_last_2.LastValue)  # -> Index, Count; disabled
item_2 = ListItem(List=sort_2.ValuesA, Index=[mindex_3.Index, mindex_4.Index], Wrap=True)  # disabled
crv_3 = Curve(item_2)  # disabled

# ---- group: Non-planar_b / continuous toolpath
number_slider_15 = Slider(0, range=0..10)  # disabled
number_slider_16 = Slider(20, range=0..100)  # disabled
neg_3 = Negative(Value=number_slider_16)  # disabled
ext_2 = ExtendCurve(Curve=tweencrv_2, Type=0, Start=number_slider_15, End=neg_3)  # disabled
end_3 = EndPoints(Curve=ext_2)  # -> Start, End; disabled
panel_11 = Panel("-1")  # disabled
shift_2 = ShiftList(List=end_3.Start, Shift=1, Wrap=invert(True))  # disabled
cull_i_2 = CullIndex(List=end_3.End, Indices=panel_11, Wrap=True)  # disabled
ln_2 = Line(StartPoint=cull_i_2, EndPoint=shift_2)  # disabled
tail_length_2 = Slider(300, range=0..1000)  # disabled
join_4 = JoinCurves(Curves=flatten([ext_2, ln_2]), Preserve=False)  # disabled
X_3 = UnitX(Factor=1)  # disabled
end_4 = EndPoints(Curve=join_4)  # -> Start, End; disabled
line_3 = LineSDL(Start=end_4.Start, Direction=X_3, Length=tail_length_2)  # disabled
join_5 = JoinCurves(Curves=[line_3, join_4], Preserve=False)  # disabled
flip_4 = FlipCurve(Curve=join_5)  # -> Curve, Flag; disabled
curvepoint_2 = PointOnCurve(flip_4.Curve, parameter=0.124)  # disabled
crv_4 = Curve(flip_4.Curve)  # disabled
number_slider_17 = Slider(5, range=0..10)  # disabled
mpipe_2 = MeshPipe(Curve=crv_4, Radius=number_slider_17, Accuracy=0.2, Rotation=0, Segments=10, Caps=2)  # disabled

# ---- group: Non-planar_a / bead height
number_slider_18 = Slider(10, range=0..100)  # disabled

# ----
py3_3 = Python3Script(C=crv_2, step=Slider(15, range=0..100), v=Slider(10, range=0..50), a=Slider(10, range=0..50))  # -> out, a; inputs C: Curve, step: Double, v: Double, a: Double
# ---------- py3_3: Python ----------
import Rhino.Geometry as rg
import math

# Inputs:
# C: Rhino curve
# step: sampling distance in mm
# v: TCP speed in m/s
# a: acceleration in m/s^2

def curve_to_points_by_length(curve, step):
    length = curve.GetLength()
    count = int(length / step)

    pts = []
    for i in range(count + 1):
        d = min(i * step, length)
        success, t = curve.LengthParameter(d)
        if success:
            pts.append(curve.PointAt(t))

    return pts


def point_to_ur_pose(pt, rx, ry, rz):
    # Rhino is usually in mm
    # URScript uses meters
    x = pt.X / 1000.0
    y = pt.Y / 1000.0
    z = pt.Z / 1000.0

    return "p[{:.6f}, {:.6f}, {:.6f}, {:.6f}, {:.6f}, {:.6f}]".format(
        x, y, z, rx, ry, rz
    )


# ------------------------------------------------------------
# Main
# ------------------------------------------------------------

pts = curve_to_points_by_length(C, step)

# Fixed TCP orientation
# This is only an example.
# You must calibrate the correct tool orientation for your robot/nozzle.
rx = math.pi
ry = 0.0
rz = 0.0

lines = []

lines.append("def print_path():")
lines.append("  set_tcp(p[0, 0, 0.120, 0, 0, 0])")
lines.append("  set_payload(1.0)")
lines.append("")

if len(pts) > 0:
    start_pose = point_to_ur_pose(pts[0], rx, ry, rz)

    lines.append("  # Move to start point")
    lines.append("  movej({}, a=0.5, v=0.1)".format(start_pose))
    lines.append("")
    lines.append("  # Start extrusion")
    lines.append("  set_digital_out(0, True)")
    lines.append("")

    for pt in pts:
        pose = point_to_ur_pose(pt, rx, ry, rz)
        lines.append("  movel({}, a={}, v={})".format(pose, a, v))

    lines.append("")
    lines.append("  # Stop extrusion")
    lines.append("  set_digital_out(0, False)")

lines.append("")
lines.append("end")

URScript = "\n".join(lines)
# ---------- end py3_3 ----------
divdist = DivideDistance(Curve=crv_2, Distance=Slider(15, range=0..100))  # -> Points, Tangents, Parameters

# ---- group: Non-planar_a
number_slider_19 = Slider(200, range=0..1000)  # disabled
Z_6 = UnitZ(Factor=dispatch.ListA)  # disabled

panel_12 = Panel("{0,0,0}")  # disabled
number_slider_20 = Slider(0, range=0..10)  # disabled
number_slider_21 = Slider(20, range=0..100)  # disabled
neg_4 = Negative(Value=number_slider_21)  # disabled
panel_13 = Panel("-1")  # disabled
tail_length_3 = Slider(300, range=0..1000)  # disabled
X_4 = UnitX(Factor=1)  # disabled
number_slider_22 = Slider(5, range=0..10)  # disabled

cir_3 = Circle(Plane=panel_12, Radius=number_slider_19)  # disabled
ptdivcrvsegs_5 = PointDivideCurveSegments(Curve=cir_3, Number=number_slider, EndPoint=False)  # -> Points, Tangents, Parameters; disabled
dispatch_6 = Dispatch(List=ptdivcrvsegs_5.Points, DispatchPattern=[True, False])  # -> ListA, ListB; disabled
move_5 = Move(Geometry=dispatch_6.ListA, Motion=Z_6)  # -> Geometry, Transform; disabled
weave_3 = Weave(Pattern=[0, 1], Stream0=move_5.Geometry, Stream1=dispatch_6.ListB, NullGaps=False)  # disabled
intcrv_3 = Interpolate(Vertices=weave_3, Degree=3, Periodic=invert(False), KnotStyle=1)  # -> Curve, Length, Domain; disabled

number_slider_23 = Slider(30, range=0..100)  # disabled
vec2pt = Vector2Pt(PointA=panel_12, PointB=move_5.Geometry, Unitize=invert(False))  # -> Vector, Length; disabled
amp = Amplitude(Vector=vec2pt.Vector, Amplitude=number_slider_23)  # disabled
move_6 = Move(Geometry=move_5.Geometry, Motion=amp)  # -> Geometry, Transform; disabled
weave_4 = Weave(Pattern=[0, 1], Stream0=move_6.Geometry, Stream1=dispatch_6.ListB, NullGaps=False)  # disabled
intcrv_4 = Interpolate(Vertices=weave_4, Degree=3, Periodic=invert(False), KnotStyle=1)  # -> Curve, Length, Domain; disabled
rotate_2 = Rotate(Geometry=intcrv_4.Curve, Angle=degrees(multiplication), Plane=PlaneXY(0, 0, 0))  # -> Geometry, Transform; disabled

pdecon_2 = Deconstruct(Point=weave_3)  # -> XComponent, YComponent, ZComponent; disabled
sort_3 = SortList(Keys=pdecon_2.ZComponent, ValuesA=weave_3)  # -> Keys, ValuesA; disabled
item_3 = ListItem(List=sort_3.ValuesA, Index=0, Wrap=True)  # disabled
crv_cp = CurveClosestPoint(Point=item_3, Curve=intcrv_3.Curve)  # -> Point, Parameter, Distance; disabled
seam = Seam(Curve=intcrv_3.Curve, Seam=crv_cp.Parameter)  # disabled

number_slider_24 = Slider(30, range=0..100)  # disabled
pt_3 = Point(dispatch_6.ListB)  # disabled
vec2pt_2 = Vector2Pt(PointA=panel_12, PointB=pt_3, Unitize=invert(False))  # -> Vector, Length; disabled
amp_2 = Amplitude(Vector=vec2pt_2.Vector, Amplitude=number_slider_24)  # disabled
move_7 = Move(Geometry=pt_3, Motion=amp_2)  # -> Geometry, Transform; disabled
weave_5 = Weave(Pattern=[0, 1], Stream0=move_5.Geometry, Stream1=move_7.Geometry, NullGaps=False)  # disabled
intcrv_5 = Interpolate(Vertices=weave_5, Degree=3, Periodic=invert(False), KnotStyle=1)  # -> Curve, Length, Domain; disabled

pdecon_3 = Deconstruct(Point=weave_5)  # -> XComponent, YComponent, ZComponent; disabled
sort_4 = SortList(Keys=pdecon_3.ZComponent, ValuesA=weave_5)  # -> Keys, ValuesA; disabled
item_4 = ListItem(List=sort_4.ValuesA, Index=0, Wrap=True)  # disabled
crv_cp_2 = CurveClosestPoint(Point=item_4, Curve=intcrv_5.Curve)  # -> Point, Parameter, Distance; disabled
seam_2 = Seam(Curve=intcrv_5.Curve, Seam=crv_cp_2.Parameter)  # disabled

rotate_3 = Rotate(Geometry=seam_2, Angle=degrees(multiplication_2), Plane=PlaneXY(0, 0, 0))  # -> Geometry, Transform; disabled

number_slider_25 = Slider(300, range=0..1000)  # disabled
division_8 = Division(A=number_slider_25, B=number_slider_18)  # disabled
Z_7 = UnitZ(Factor=number_slider_25)  # disabled
round_3 = Round(Number=division_8)  # -> Nearest, Floor, Ceiling; disabled
move_8 = Move(Geometry=rotate_3.Geometry, Motion=Z_7)  # -> Geometry, Transform; disabled
range_6 = Range(Domain=Domain(0, 1), Steps=expr("x-1", round_3.Ceiling))  # disabled
rulesrf_3 = RuledSurface(CurveA=seam, CurveB=move_8.Geometry)  # disabled
tweencrv_3 = TweenCurve(CurveA=seam, CurveB=move_8.Geometry, Factor=range_6, BlendType=0)  # disabled

ptdivcrvsegs_6 = PointDivideCurveSegments(Curve=tweencrv_3, Number=number_slider, EndPoint=False)  # -> Points, Tangents, Parameters; disabled
ext_3 = ExtendCurve(Curve=tweencrv_3, Type=0, Start=number_slider_20, End=neg_4)  # disabled
flip_5 = FlipMatrix(Data=ptdivcrvsegs_6.Points)  # disabled
end_5 = EndPoints(Curve=ext_3)  # -> Start, End; disabled
shift_3 = ShiftList(List=end_5.Start, Shift=1, Wrap=invert(True))  # disabled
pline_3 = PolyLine(Vertices=flip_5, Closed=False)  # -> flatten(Polyline); disabled
cull_i_3 = CullIndex(List=end_5.End, Indices=panel_13, Wrap=True)  # disabled
explode_3 = Explode(Curve=pline_3, Recursive=True)  # -> Segments, Vertices; disabled
ln_3 = Line(StartPoint=cull_i_3, EndPoint=shift_3)  # disabled
len_3 = Length(Curve=explode_3.Segments)  # disabled
join_6 = JoinCurves(Curves=flatten([ext_3, ln_3]), Preserve=False)  # disabled
sort_5 = SortList(Keys=flatten(len_3), ValuesA=flatten(explode_3.Segments))  # -> Keys, ValuesA; disabled
end_6 = EndPoints(Curve=join_6)  # -> Start, End; disabled
first_last_3 = FirstLast(List=sort_5.Keys)  # -> FirstValue, LastValue; disabled
line_4 = LineSDL(Start=end_6.Start, Direction=X_4, Length=tail_length_3)  # disabled
join_7 = JoinCurves(Curves=[line_4, join_6], Preserve=False)  # disabled
panel_14 = Panel(first_last_3.FirstValue)  # disabled
panel_15 = Panel(first_last_3.LastValue)  # disabled
mindex_5 = MemberIndex(Set=sort_5.Keys, Member=first_last_3.FirstValue)  # -> Index, Count; disabled
mindex_6 = MemberIndex(Set=sort_5.Keys, Member=first_last_3.LastValue)  # -> Index, Count; disabled
flip_6 = FlipCurve(Curve=join_7)  # -> Curve, Flag; disabled
item_5 = ListItem(List=sort_5.ValuesA, Index=[mindex_5.Index, mindex_6.Index], Wrap=True)  # disabled
curvepoint_3 = PointOnCurve(flip_6.Curve, parameter=0.124)  # disabled
crv_5 = Curve(flip_6.Curve)  # disabled
crv_6 = Curve(item_5)  # disabled
mpipe_3 = MeshPipe(Curve=crv_5, Radius=number_slider_22, Accuracy=0.2, Rotation=0, Segments=10, Caps=2)  # disabled
